# Dynamo graph Automation using Excel Sheet.dyn "CreateDataFromExcel1" (Dynamo 2.12.0.5650)

# group: Input Excel
file_path = Filename("F:\Dynamo\Scripts\Iti Tasks\Day - 03\ProjectStartup.xlsx")
file_from_path = FileObject(path=file_path)

# group: List Control
code_block = CodeBlock { ["Levels","Floor Plans","Reflected Ceiling Plans","Sheets"]; }
importExcel = Data.ImportExcel(file=file_from_path, sheetName=code_block)

# group: Levels
code_block_2 = CodeBlock(L=importExcel)
# ---------- code_block_2.designscript (4 lines) ----------
List.Transpose(List.RestOfItems(L));
List.GetItemAtIndex(List.Transpose(List.RestOfItems(List.GetItemAtIndex(L,0))),1);
"Name";
Names = List.FirstItem(List.Transpose(List.RestOfItems(List.GetItemAtIndex(L,0))));
# ----------------------------------------
byElevation = Level.ByElevation(elevation=code_block_2.out1)
setParameterByName = Element.SetParameterByName(element=byElevation, parameterName=code_block_2.out2, value=code_block_2.Names)

# group: Floors
code_block_3 = CodeBlock { 2; }
cycle = List.Cycle(list=byElevation, amount=code_block_3)
byLevel = FloorPlanView.ByLevel(level=cycle)
code_block_4 = CodeBlock(L=importExcel) { "View Name"; List.FirstItem(List.Transpose(List.RestOfItems(List.GetItemAtIndex(L,1)))); }
setParameterByName_2 = Element.SetParameterByName(element=byLevel, parameterName=code_block_4.out0, value=code_block_4.out1)

# group: Reflected Ceiling Plans
byLevel_2 = CeilingPlanView.ByLevel(level=cycle)
code_block_5 = CodeBlock(L=importExcel) { "View Name"; List.FirstItem(List.Transpose(List.RestOfItems(List.GetItemAtIndex(L,2)))); }
setParameterByName_3 = Element.SetParameterByName(element=byLevel_2, parameterName=code_block_5.out0, value=code_block_5.out1)

# group: Create Sheets
code_block_6 = CodeBlock(L=importExcel)
# ---------- code_block_6.designscript (4 lines) ----------
SheetName = List.GetItemAtIndex(List.Transpose(List.RestOfItems(List.GetItemAtIndex(L,3))),1);
SheetNo = List.GetItemAtIndex(List.Transpose(List.RestOfItems(List.GetItemAtIndex(L,3))),0);
"A1 metric";
SheetView = List.GetItemAtIndex(List.Transpose(List.RestOfItems(List.GetItemAtIndex(L,3))),2);
# ----------------------------------------
family_types = FamilyTypes("A1 metric:A1 metric")
join = List.Join(list0=setParameterByName_2, list1=setParameterByName_3)
name = Element.Name(element=join)
indexOf = List.IndexOf(list=name, element=code_block_6.SheetView)
getItemAtIndex = List.GetItemAtIndex(list=join, index=indexOf)
byNameNumberTitleBlockAndView = Sheet.ByNameNumberTitleBlockAndView(sheetName=code_block_6.SheetName, sheetNumber=code_block_6.SheetNo, titleBlockFamilyType=family_types, view=getItemAtIndex)
