# Dynamo graph CreateDataFromExcel.dyn (Dynamo 2.12.0.5650)
# packages: Clockwork for Dynamo 2.x 2.4.0

file_path = Filename("F:\Dynamo\Scripts\Iti Tasks\Day - 03\ProjectStartup.xlsx")
file_from_path = FileObject(path=file_path)

# group: Levels
string = StringInput("Levels")
importExcel = Data.ImportExcel(file=file_from_path, sheetName=string)
code_block = CodeBlock(L=importExcel)
# ---------- code_block.designscript (4 lines) ----------
List.Transpose(List.RestOfItems(L));
List.GetItemAtIndex(List.Transpose(List.RestOfItems(L)),1);
"Name";
List.FirstItem(List.Transpose(List.RestOfItems(L)));
# ----------------------------------------
byElevation = Level.ByElevation(elevation=code_block.out1)
setParameterByName = Element.SetParameterByName(element=byElevation, parameterName=code_block.out2, value=code_block.out3)

code_block_2 = CodeBlock { "Type"; "Ceiling Plan"; }
setParameterByName_2 = Element.SetParameterByName(parameterName=code_block_2.out0, value=code_block_2.out1)  # unwired: element
setType = Custom[FamilyInstance.SetType]()  # package Clockwork for Dynamo 2.x; Changes the family type of a given family instance to the specified type; unwired: familyInstance, familyType
types = Family.Types()  # unwired: family
name = FamilyType.Name()  # unwired: familyType
family = FamilyType.Family()  # unwired: familyType
code_block_3 = CodeBlock { "System Family: Ceiling Plan"; }
byName = FamilyType.ByName(name=code_block_3)
id = FamilyParameter.Id()  # unwired: familyParameter
byName_2 = Family.ByName(name=code_block_3)
containsElementsOfCategory = Custom[Document.ContainsElementsOfCategory]()  # package Clockwork for Dynamo 2.x; Checks if family instances of specified categories are present in the model.; unwired: category
setSheetName = Sheet.SetSheetName()  # unwired: sheet, sheetName

# group: Floors
code_block_4 = CodeBlock { 2; }
cycle = List.Cycle(list=byElevation, amount=code_block_4)
byLevel = FloorPlanView.ByLevel(level=cycle)
string_2 = StringInput("Floor Plans")
importExcel_2 = Data.ImportExcel(file=file_from_path, sheetName=string_2)
code_block_5 = CodeBlock(L=importExcel_2) { "View Name"; List.FirstItem(List.Transpose(List.RestOfItems(L))); }
setParameterByName_3 = Element.SetParameterByName(element=byLevel, parameterName=code_block_5.out0, value=code_block_5.out1)

# group: Reflected Ceiling Plans
byLevel_2 = CeilingPlanView.ByLevel(level=cycle)
string_3 = StringInput("Reflected Ceiling Plans")
importExcel_3 = Data.ImportExcel(file=file_from_path, sheetName=string_3)
code_block_6 = CodeBlock(L=importExcel_3) { "View Name"; List.FirstItem(List.Transpose(List.RestOfItems(L))); }
setParameterByName_4 = Element.SetParameterByName(element=byLevel_2, parameterName=code_block_6.out0, value=code_block_6.out1)

# group: Create Sheets
code_block_7 = CodeBlock { ["Reflected Ceiling Plans","Sheets"]; }
importExcel_4 = Data.ImportExcel(file=file_from_path, sheetName=code_block_7)
code_block_8 = CodeBlock(L=importExcel_4)
# ---------- code_block_8.designscript (4 lines) ----------
SheetName = List.GetItemAtIndex(List.Transpose(List.RestOfItems(List.GetItemAtIndex(L,1))),1);
SheetNo = List.GetItemAtIndex(List.Transpose(List.RestOfItems(List.GetItemAtIndex(L,1))),0);
"A1 metric";
SheetView = List.GetItemAtIndex(List.Transpose(List.RestOfItems(List.GetItemAtIndex(L,1))),2);
# ----------------------------------------
family_types = FamilyTypes("A1 metric:A1 metric")
join = List.Join(list0=setParameterByName_3, list1=setParameterByName_4)
name_2 = Element.Name(element=join)
indexOf = List.IndexOf(list=name_2, element=code_block_8.SheetView)
getItemAtIndex = List.GetItemAtIndex(list=join, index=indexOf)
byNameNumberTitleBlockAndView = Sheet.ByNameNumberTitleBlockAndView(sheetName=code_block_8.SheetName, sheetNumber=code_block_8.SheetNo, titleBlockFamilyType=family_types, view=getItemAtIndex)
